vi "Get Earthquake Count.gviweb"   [LabVIEW NXG 2.0.0]
inputs:
  "JSON in": string
  "error in": error
outputs:
  "Earthquake count": i32
  "error out": error
types:
  T1 = cluster{"generated": i32, "url": string, "title": string, "status": i32, "api": string, "count": i32}
diagram:
  w1 = T1 {all zero or empty}  # metadata
  Unflatten From JSON(JSON string=$"JSON in", error in (no error)=$"error in", path=["metadata"], type and defaults=w1) -> (error out=w2, value=w3)
  Property Node(instance in=w3) -> ("count"=w4)
  $"Earthquake count" <- w4
  $"error out" <- w2
