vi "Main.gviweb"   [LabVIEW NXG 2.0.0]
panel controls:
  "Sample Length (s)": i32 = 10
  "Signal Amplitude": f64 = 1
  "Sample Rate (Hz)": i32 = 100
  "Noise %": f64 = 25
  "Signal Frequency": f64 = 1
  "Hyperlink Control": string = "https://github.com/ni/webvi-examples/tree/ad0a92c4696674f290b4e2a02c514360be7b299d/Call%20LabVIEW%20Web%20Service"
  "Hyperlink Control_2": string = "https://github.com/ni/webvi-examples/tree/ad0a92c4696674f290b4e2a02c514360be7b299d/Call%20LabVIEW%20Web%20Service"
panel indicators:
  "Observed Data and Fitted Curve": cluster{"Element 1": f64, "Element 2": f64}[][]
  "Signal": cluster{"Element 1": f64, "Element 2": f64}[]
  "Spectrum": cluster{"Element 1": f64, "Element 2": f64}[]
  "LED": bool
types:
  T1 = cluster{"X": f64[], "Y": f64[], "Best Gaussian Fit": f64[], "Upper Bound": f64[], "Lower Bound": f64[]}
  T2 = cluster{"Samples": i32, "Amplitude": f64, "Frequency": f64, "Noise%": f64}
uses:
  NI::G Core::Error::Clear Error Cluster.gvi
  NI::HTTP::GET.gvi
  NI::HTTP::POST Buffer.gvi
diagram:
  s1 = uninitialised  # shift register
  while {
    Wait(time to wait=500)
    case (s1) {
      frame Error, Default {
        $LED <- TRUE
        call "Clear Error Cluster.gvi"(error in=s1) -> (error out=w2)
        # If there is an error, highlight the text pointing to where to download the LabVIEW Web service. HTTP errors are mostly likely due to the Web service not running.
        #
        # Check on each loop iteration to ensure there Web server is still down by clearing the error and calling GET. This allows us to exit the error state if the Web server comes back while the example is running.
        call "GET.gvi"(url="http://127.0.0.1:8001/Web_Server/ParametricCurve", error in=w2) -> (error out=w1)
      }
      frame No Error {
        $LED <- FALSE
        call "GET.gvi"(url="http://127.0.0.1:8001/Web_Server/ParametricCurve", error in=s1) -> (body=w3, error out=w4)
        Unflatten From JSON(JSON string=w3, error in (no error)=w4, type and defaults=T1 {all zero or empty}) -> (error out=w5, value=w6)
        Property Node(instance in=w6) -> ("X"=w7, "Y"=w8, "Best Gaussian Fit"=w9, "Upper Bound"=w10, "Lower Bound"=w11)
        Build Index And Bundle Cluster Array(w7, w8) -> (out=w12)
        Build Index And Bundle Cluster Array(w7, w9) -> (out=w13)
        Build Index And Bundle Cluster Array(w7, w10) -> (out=w14)
        Build Index And Bundle Cluster Array(w7, w11) -> (out=w15)
        Build Array(w12, w13, w14, w15) -> w16
        $"Observed Data and Fitted Curve" <- w16
        Reciprocal(x=$"Sample Rate (Hz)") -> w17
        Multiply($"Sample Length (s)", $"Sample Rate (Hz)") -> w18
        Divide(x=$"Signal Frequency", y=$"Sample Rate (Hz)") -> w19
        Property Node(instance in=T2 {all zero or empty}, "Samples"=w18, "Frequency"=w19, "Amplitude"=$"Signal Amplitude", "Noise%"=$"Noise %") -> (instance out=w20)
        Flatten To JSON(anything=w20, error in (no error)=w5) -> (JSON string=w21, error out=w22)
        call "POST Buffer.gvi"(url="http://127.0.0.1:8001/Web_Server/SignalAndSpectrum", buffer=w21, error in=w22) -> (body=w23, error out=w24)
        w25 = cluster{"Signal": f64[], "Spectrum": f64[]} {all zero or empty}
        Unflatten From JSON(JSON string=w23, error in (no error)=w24, type and defaults=w25) -> (error out=w1, value=w26)
        Property Node(instance in=w26) -> ("Signal"=w27, "Spectrum"=w28)
        for (iteration -> i1) {
          w29 = each element of w27
          Multiply(i1, w17) -> w31
          Build Cluster(w31, w29) -> w32
          append w32 to w30
        }
        $Signal <- w30
        # Get data from LabVIEW Web service, unflatten the data, and format it so it can be displayed in a single graph.
        #
        # Post data to LabVIEW Web service, unflatten the  response data, format the data, and plot on two graphs
        Divide(x=$"Sample Rate (Hz)", y=2) -> w33
        Reciprocal(x=$"Sample Length (s)") -> w34
        for (iteration -> i2) {
          w35 = each element of w28
          Multiply(w34, i2) -> w37
          Build Cluster(w37, w35) -> w38
          Is Greater(x=w37, y=w33) -> w39
          append w38 to w36
          stop if w39
        }
        $Spectrum <- w36
      }
    }
    next s1 = w1
    stop if FALSE
  }
