vi "Read TDMS Data.gviweb"   [LabVIEW NXG 4.0.0]
panel controls:
  "Matching File IDs": i32 = -1
  "Authentication Credentials": i32 = 2
  "password": string
  "username": string
  "server url": string
  "API Key": string
  "Hyperlink Control": string = "Read Write Messages.html"
  "Hyperlink Control_2": string = "Read Tags.html"
  "Hyperlink Control_3": string = "https://www.systemlinkcloud.com/tags/viewer"
panel indicators:
  "error out": error
  "Graph": f64[]
uses:
  NI::Skyline::Configuration::Open Configuration.gvi
  NI::Skyline::Configuration::Open Configuration API Key.gvi
  NI::Skyline::File::Create Filter (Name).gvi
  NI::Skyline::TDMReader::Query TDMS Files.gvi
  NI::Skyline::TDMReader::Open File.gvi
  NI::Skyline::TDMReader::Read Data (1Chan Double).gvi
diagram:
  # Open a connection to SystemLink Server or SystemLink Cloud
  case ($"Authentication Credentials") {
    frame 0, Default {
      call "Open Configuration.gvi"(server url=$"server url", username=$username, password=$password) -> (configuration=w1, error out=w2)
    }
    frame 2 {
      # No credentials required when deploying to SystemLink Cloud or NI Web Server
      call "Open Configuration.gvi"() -> (configuration=w1, error out=w2)
    }
    frame 1 {
      call "Open Configuration API Key.gvi"(server url="https://api.systemlinkcloud.com", api key=$"API Key") -> (configuration=w1, error out=w2)
    }
  }
  # Find all TDMS files with "demo" in the filename
  call "Create Filter (Name).gvi"(name="demo", error in=w2) -> (filter out=w3, error out=w4)
  call "Query TDMS Files.gvi"(filter in=w3, error in=w4, configuration=w1) -> (tdm files=w5)
  for {
    w6 = each element of w5
    Property Node(instance in=w6) -> ("file id"=w8)
    append w8 to w7
  }
  Property Node(instance in=reference to "Matching File IDs", "Items"=w7) -> (error out=w9)
  while {
    event {
      on "Matching File IDs" Value changed {
        Array Index(array=w7) -> (out0[$"Matching File IDs"]=w11)
        Is Empty String Or Path(string/path=w11) -> w12
        case (w12) {
          frame True {
            w10 = w9
          }
          frame False {
            # Open a TDMS file and read 500 points from first channel
            call "Open File.gvi"(file id=w11, error in=w9, configuration=w1) -> (tdm file=w13, error out=w14)
            call "Read Data (1Chan Double).gvi"(tdm file in=w13, error in=w14, count=500) -> (data=w15, error out=w10)
            $Graph <- w15
          }
        }
      }
    }
    $"error out" <- w10
    stop if FALSE
  }
