vi "Main.gvi"   [LabVIEW NXG 3.1.0]
panel controls:
  "password": string
  "username": string
  "server url": string
  "SystemLink.Examples.DataServices.int_control": bool
  "SystemLink.Examples.DataServices.numeric_slider-control": f64
  "SystemLink.Examples.DataServices.string_control": string
  "SystemLink.Examples.Oven.Inside.Temp-slider-control": f64
  "SystemLink.Examples.Oven.Outside.Temp-slider-control": f64
  "connect": bool
  "Tab": i32
  "Hyperlink Control": string = "http://github.com/ni/webvi-examples/tree/master/CallSystemLinkDataServices"
  "auth picker": i32
  "api key": string
  "dequeue message": bool
  "Numeric": f64
  "Switch": bool
  "Enum": T1 = "State One"
  "String": string
  "Publish message": bool
panel indicators:
  "debugging tips": string
  "SystemLink.Examples.DataServices.int_indicator": bool
  "SystemLink.Examples.DataServices.numeric_indicator": f64
  "SystemLink.Examples.DataServices.string_indicator": string
  "SystemLink.Examples.Oven.Inside.Temp_indicator": f64
  "SystemLink.Examples.Oven.Outside.Temp_indicator": f64
  "Numeric Indicator": f64
  "Square LED": bool
  "Listbox": i32
  "String Indicator": string
  "Queued Messages Remaining": f64
types:
  T1 = enum{"State One", "State Two ", "State Three", "State Four", "State Five"}
  "Message Cluster.gtype" = cluster{"Numeric": f64, "Switch": bool, "State": u16, "String": string}
uses:
  subvis::Read Example Tags.gvi
  subvis::Write Example Tags.gvi
  subvis::Publish Message.gvi
  subvis::Update Remaining Queue Indicator.gvi
  subvis::Deque Message.gvi
  NI::G Core::Error::Clear Error Cluster.gvi
  subvis::Initialize.gvi
  subvis::Build Error Message.gvi
  subvis::Determine Next State.gvi
diagram:
  w1 = "initialize"  # State
  # This diagram is identical to Main.gviweb.
  s1 = uninitialised  # shift register
  s2 = uninitialised  # shift register
  s3 = w1  # shift register
  s4 = uninitialised  # shift register
  while {
    Wait(time to wait=250)
    case (s3) {
      frame "read-tags" {
        call "Read Example Tags.gvi"(SystemLink Connection=s2, error in=s1) -> (SystemLink Connection out=w4, SystemLink.Examples.DataServices.bool_indicator=w6, SystemLink.Examples.DataServices.numeric_indicator=w7, SystemLink.Examples.DataServices.string_indicator=w8, SystemLink.Examples.Oven.Inside.Temp-tank-indicator=w9, SystemLink.Examples.Oven.Outside.Temp-tank-indicator=w10, error out=w3)
        $"SystemLink.Examples.DataServices.int_indicator" <- w6
        $"SystemLink.Examples.DataServices.int_control" <- w6
        $"SystemLink.Examples.DataServices.numeric_indicator" <- w7
        $"SystemLink.Examples.DataServices.numeric_slider-control" <- w7
        $"SystemLink.Examples.DataServices.string_indicator" <- w8
        $"SystemLink.Examples.DataServices.string_control" <- w8
        $"SystemLink.Examples.Oven.Inside.Temp_indicator" <- w9
        $"SystemLink.Examples.Oven.Inside.Temp-slider-control" <- w9
        $"SystemLink.Examples.Oven.Outside.Temp-slider-control" <- w10
        # Updates both controls and indicators to ensure that tag values aren't overwritten between swtiching tabs
        $"SystemLink.Examples.Oven.Outside.Temp_indicator" <- w10
        w2 = $Tab
        w5 = default
      }
      frame "write-tags" {
        call "Write Example Tags.gvi"(SystemLink Connection=s2, SystemLink.Examples.DataServices.bool_control=$"SystemLink.Examples.DataServices.int_control", SystemLink.Examples.DataServices.numeric_slider-control=$"SystemLink.Examples.DataServices.numeric_slider-control", SystemLink.Examples.DataServices.string_control=$"SystemLink.Examples.DataServices.string_control", SystemLink.Examples.Oven.Inside.Temp-slider-control=$"SystemLink.Examples.Oven.Inside.Temp-slider-control", SystemLink.Examples.Oven.Outside.Temp-slider-control=$"SystemLink.Examples.Oven.Outside.Temp-slider-control", error in=s1) -> (SystemLink Connection out=w4, errror out=w3)
        w2 = $Tab
        w5 = default
      }
      frame "write-message" {
        event {
          on "Publish message" Value changed {
            Property Node(instance in="Message Cluster.gtype" {all zero or empty}, "Numeric"=$Numeric, "Switch"=$Switch, "State"=$Enum, "String"=$String) -> (instance out=w11)
            call "Publish Message.gvi"(SystemLink Connection=s2, Message Cluster=w11, error=s1) -> (SystemLink Connection out=w4, error out=w3)
            w2 = s3
          }
          on "Tab" Value changed {
            w4 = s2
            w3 = s1
            w2 = $Tab
          }
        }
        w5 = default
      }
      frame "read-message" {
        call "Update Remaining Queue Indicator.gvi"(SystemLink Connection=s2, queue size=s4, error in=s1) -> (SystemLink Connection out=w12, updated queue sie=w5, Queued Messages Remaining=w13, error out=w14)
        $"Queued Messages Remaining" <- w13
        call "Deque Message.gvi"(SystemLink Connection=w12, deque message=$"dequeue message", error in=w14) -> (SystemLink Connection out=w4, Message Out=w15, error out=w3)
        Property Node(instance in=w15) -> ("Numeric"=w16, "Switch"=w17, "State"=w18, "String"=w19)
        $"Numeric Indicator" <- w16
        $"Square LED" <- w17
        $Listbox <- w18
        $"String Indicator" <- w19
        w2 = $Tab
      }
      frame "initialize", Default {
        w20 = ["Skyline.Examples.DataServices.bool", "Skyline.Examples.DataServices.numeric", "Skyline.Examples.DataServices.string", "Skyline.Examples.Oven.Inside.Temp", "Skyline.Examples.Oven.Outside.Temp"]
        call "Clear Error Cluster.gvi"(error in=s1) -> (error out=w21)
        sequence {
          frame 0 {
            $"debugging tips" <- ""
          }
        }
        call "Initialize.gvi"(server url=$"server url", username=$username, password=$password, api key=$"api key", tag paths=w20, AuthPicker=$"auth picker", error in=w21) -> (SystemLink Connection=w4, error out=w3)
        w22 = "read-tags"  # State
        w2 = w22
        w5 = default
      }
      frame "error-no-systemlink" {
        call "Build Error Message.gvi"(error in=s1) -> (error out=w3, error state=w23)
        $"debugging tips" <- w23
        w2 = s3
        w4 = s2
        w5 = default
      }
    }
    call "Determine Next State.gvi"(state in=w2, connect=$connect, error in=w3) -> (state out=w24, errror out=w25)
    next s1 = w25
    next s2 = w4
    next s3 = w24
    next s4 = w5
    stop if FALSE
  }
