vi "Main.gviweb"   [LabVIEW NXG 3.1.0]
# This example uses the JavaScript Library Interface (JSLI) to connect to a WebSocket Echo Server.
panel controls:
  "Message": string
  "WebSocket URL": string = "ws://echo.websocket.org/"
  "Send": bool
  "Disconnect": bool
  "Connect": bool
  "Hyperlink Control": string = "https://github.com/ni/webvi-examples/tree/master/ConnectWebVIToWebSocketEchoServer"
panel indicators:
  "Messages": string
  "Close Error": error
  "Send/Receive Error": error
uses:
  WebSocket Client Library::WebSocket Client.jsli::Open WebSocket
  Chat::subvis::Check If Empty.gviweb
  Chat::subvis::Format Sent Message.gviweb
  WebSocket Client Library::WebSocket Client.jsli::Send Message
  Chat::subvis::Format Log to Console.gviweb
  WebSocket Client Library::WebSocket Client.jsli::Check Message
  Chat::subvis::Format Received Message.gviweb
  WebSocket Client Library::WebSocket Client.jsli::Close WebSocket
diagram:
  Concatenate Strings("Welcome to EchoServer Chat!", "\r\n") -> w1
  # 1. Connects to the echo server.
  while {
    w2 = $"WebSocket URL"
    stop if $Connect
  }
  call "Open WebSocket"(wsURI=w2) -> (error out=w3)
  # To reference external JavaScript files, you must add script tags to the HTML source panel.
  # This example uses the following script tags:
  #
  # <script src="javascript/WebSocketWrapper.js" type="application/javascript"></script>
  # 4. Disconnects from
  # the echo server.
  s1 = w1  # shift register
  while {
    Wait(time to wait=50)
    call "Check If Empty.gviweb"(Message In=$Message, Send=$Send) -> (Message Out=w4, Send?=w5)
    # 2. Sends, logs to console,
    # and displays a message
    # every time the user clicks
    #  the Send button.
    case (w5) {
      frame False, Default {
        w6 = s1
        w7 = w3
      }
      frame True {
        call "Format Sent Message.gviweb"(Chat=s1, Message=w4) -> (Formatted Message=w6)
        call "Send Message"(message=w4, error in=w3) -> (error out=w8)
        call "Format Log to Console.gviweb"(Input=w4, error in=w8) -> (error out=w7)
      }
    }
    call "Check Message"(error in=w7) -> (lastMessage=w9, error out=w10)
    call "Format Received Message.gviweb"(Chat In=w6, lastMessage=w9) -> (Chat Out=w11)
    $Messages <- w11
    $"Send/Receive Error" <- w10
    # 3. Polls for the latest
    # message every iteration.
    # Displays only if the
    # latest message is not
    # an empty string.
    next s1 = w11
    stop if $Disconnect
  }
  call "Close WebSocket"(error in=w10) -> (error out=w12)
  $"Close Error" <- w12
