vi "Main.gviweb"   [LabVIEW NXG 2.0.0]
panel controls:
  "Multiplier": bool
  "Main Fill Level": f64
  "Power Button": bool
panel indicators:
  "URL Image": string
  "Start filling": f64
  "Graph": f64[][]
  "Fill Level": f64
  "LED": bool
  "LED_2": bool
  "Chart": f64
  "Progress Bar": f64
  "Residuals Mean": f64
  "% Completed": f64
diagram:
  while (iteration -> i1) {
    Random Number() -> (number (0 to 1)=w1)
    Is Greater(x=w1, y=0.5) -> w2
    $LED <- w2
    Quotient And Remainder(x=i1, y=100) -> (floor(x/y)=w3, x-y*floor(x/y)=w4)
    Add($"Main Fill Level", w3) -> w5
    Multiply(w1, 10) -> w6
    Multiply(w6, w5) -> w7
    case ($"Power Button") {
      frame False, Default { }
      frame True {
        $"Start filling" <- w7
        $"Fill Level" <- w5
      }
    }
    Not(x=w2) -> w8
    $LED_2 <- w8
    $"Progress Bar" <- w4
    $"% Completed" <- w4
    for (N = 5) {
      for (N = 50) {
        Random Number() -> (number (0 to 1)=w11)
        $"Residuals Mean" <- w11
        Select(s=$Multiplier, t=100, f=1) -> w12
        Multiply(w11, w12) -> w13
        $Chart <- w13
        append w13 to w10
      }
      append w10 to w9
    }
    $Graph <- w9
    Wait(time to wait=50)
    stop if FALSE
  }
