vi "Main.gviweb"   [LabVIEW NXG 2.0.0]
panel controls:
  "Multiplier": bool
  "Main Fill Level": f64
  "Power Button": bool
  "Hyperlink Control": string = "https://github.com/ni/webvi-examples/tree/master/CustomizeWithCss"
panel indicators:
  "Start filling": f64
  "Graph": f64[][]
  "Fill Level": f64
  "Residuals Mean": f64
  "% Completed": f64
  "URL Image": string
  "URL Image_2": string
  "URL Image_3": string
diagram:
  while (iteration -> i1) {
    Quotient And Remainder(x=i1, y=100) -> (floor(x/y)=w1, x-y*floor(x/y)=w2)
    Add($"Main Fill Level", w1) -> w3
    Random Number() -> (number (0 to 1)=w4)
    Multiply(w4, 10) -> w5
    Multiply(w5, w3) -> w6
    case ($"Power Button") {
      frame False, Default { }
      frame True {
        $"Start filling" <- w6
        $"Fill Level" <- w3
      }
    }
    $"% Completed" <- w2
    for (N = 5) {
      for (N = 50) {
        Random Number() -> (number (0 to 1)=w9)
        $"Residuals Mean" <- w9
        Select(s=$Multiplier, t=100, f=1) -> w10
        Multiply(w9, w10) -> w11
        append w11 to w8
      }
      append w8 to w7
    }
    $Graph <- w7
    Wait(time to wait=50)
    stop if FALSE
  }
