vi "MobileTest.gviweb"   [LabVIEW NXG 2.1.0]
panel controls:
  "Button": bool
panel indicators:
  "bool test": bool
  "numeric test": bool
  "string test": bool
  "Output": error
  "test": bool
  "String": string
uses:
  subvis::Initialize.gvi
  subvis::Write Example Tags.gvi
  subvis::Read Example Tags.gvi
diagram:
  w1 = "run test"  # State
  s1 = w1  # shift register
  s2 = uninitialised  # shift register
  while {
    case (s1) {
      frame "run test", Default {
        $String <- "Test Running..."
        w4 = "wait"  # State
        for (N = 5) {
          Random Number() -> (number (0 to 1)=w6)
          append w6 to w5
        }
        Array Index(array=w5) -> (out0[_]=w7, out1[_]=w8, out2[_]=w9, out3[_]=w10, out4[_]=w11)
        Format Into String(w9) -> w12
        Round To Nearest(number=w7) -> w13
        Is Equal To 0(x=w13) -> w14
        Multiply(w8, 100) -> w15
        Round To Nearest(number=w15) -> w16
        disable {
          frame Disabled { }
          frame Enabled {
            # Enter server URL and API key here
            w17 = ""
            w18 = ""
          }
        }
        w19 = ["mobiletest.bool", "mobiletest.numeric", "mobiletest.string", "mobiletest.Inside.Temp", "mobiletest.Outside.Temp"]
        call "Initialize.gvi"(server url=w18, api key=w17, tag paths=w19, AuthPicker="API Key") -> (error out=w20, SystemLink Connection=w21)
        call "Write Example Tags.gvi"(SystemLink Connection=w21, example.skyline-data-services.int_control=w14, example.skyline-data-services.numeric_slider-control=w16, example.skyline-data-services.string_control=w12, Skyline.Examples.Oven.Inside.Temp-slider-control=w10, Skyline.Examples.Oven.Outside.Temp-slider-control=w11, error in=w20) -> (SystemLink Connection out=w22, errror out=w23)
        sequence {
          frame 0 {
            Wait(time to wait=250)
          }
        }
        call "Read Example Tags.gvi"(SystemLink Connection=w22, error in=w23) -> (example.skyline-data-services.int_indicator=w24, example.skyline-data-services.numeric_gauge-indicator=w25, example.skyline-data-services.string_indicator=w26, Skyline.Examples.Oven.Outside.Temp-tank-indicator=w27, error out=w28)
        sequence (after w10) (after w27) {
          frame 0 {
            Is Equal(x=w14, y=w24) -> w29
            $"bool test" <- w29
            Is Equal(x=w16, y=w25) -> w30
            $"numeric test" <- w30
            Is Equal(x=w26, y=w12) -> w31
            Property Node(instance in=w28) -> ("status"=w32)
            Not(x=w32) -> w33
            Logical And(w29, w30, w31, w33) -> w3
            $test <- w3
            $Output <- w28
            $"string test" <- w31
          }
        }
        w2 = w4
      }
      frame "wait" {
        Wait(time to wait=100)
        w34 = "run test"  # State
        w35 = "wait"  # State
        Select(s=$Button, t=w34, f=w35) -> w36
        case (w36) {
          frame "run test", Default {
            $Output <- no error
            $"string test" <- FALSE
            $test <- FALSE
            $"bool test" <- FALSE
            $"numeric test" <- FALSE
            w2 = w36
            w3 = FALSE
          }
          frame "wait" {
            w2 = w36
            w3 = s2
          }
        }
        Select(s=s2, t="Test past", f="Test fail") -> w37
        $String <- w37
      }
    }
    next s1 = w2
    next s2 = w3
    stop if FALSE
  }
