vi "Determine Next State.gvi"   [LabVIEW NXG 2.0.0]
inputs:
  "state in": T1 = "error-no-skyline"
  "error in": error
  "connect": bool
outputs:
  "errror out": error
  "state out": T1
types:
  T1 = enum{"read-tags", "write-tags", "read-message", "write-message", "error-no-skyline", "initialize"}
diagram:
  Select(s=$"error in", t="error-no-skyline", f=$"state in") -> w1
  Select(s=$connect, t="initialize", f=w1) -> w2
  $"state out" <- w2
  # Go to the state determined by the tab control.
  #
  # If there is an error go to the error state.
  #
  # If the user clicks Connect then go to the Initialize state regardless if there is an error.
  $"errror out" <- $"error in"
