vi "Handle Error and Reconnect.gvi"   [LabVIEW NXG 2.0.0]
inputs:
  "state in": i32
  "Error_2": error
  "connect": bool
outputs:
  "Error_3": error
  "state out": i32
diagram:
  Select(s=$Error_2, t="error-no-skyline", f=$"state in") -> w1
  Select(s=$connect, t="initialize", f=w1) -> w2
  $"state out" <- w2
  $Error_3 <- $Error_2
