vi "Initialize.gvi"   [LabVIEW NXG 2.1.0]
inputs:
  "server url": string
  "username": string
  "password": string
  "error in": error
  "AuthPicker": "AuthPicker.gtype" = "User Name + Password"
  "api key": string
  "tag paths": string[] = ["Skyline.Examples.DataServices.bool", "Skyline.Examples.DataServices.numeric", "Skyline.Examples.DataServices.string", "Skyline.Examples.Oven.Inside.Temp", "Skyline.Examples.Oven.Outside.Temp"]
outputs:
  "error out": error
  "tags": "Tag.gtype"[]
types:
  "DataType.gtype" = enum{"Double", "Integer", "String"}
  "Client Handle.gtype" = u32
  "Configuration.gtype" = cluster{"Server URL": string, "Session": "Client Handle.gtype"}
  "Tag.gtype" = cluster{"Path": string, "Datatype": "DataType.gtype", "Configuration": "Configuration.gtype"}
  "AuthPicker.gtype" = enum{"User Name + Password", "API Key"}
uses:
  NI::Skyline::Configuration::Open Configuration.gvi
  NI::Skyline::Configuration::Open Configuration API Key.gvi
  NI::Skyline::TagHTTP::Open Tag.gvi
diagram:
  case ($AuthPicker) {
    frame "User Name + Password", Default {
      call "Open Configuration.gvi"(server url=$"server url", username=$username, password=$password, error in=$"error in") -> (configuration=w1, error out=w2)
    }
    frame "API Key" {
      call "Open Configuration API Key.gvi"(server url=$"server url", api key=$"api key", error in=$"error in") -> (configuration=w1, error out=w2)
    }
  }
  Build Array("Integer", "Double", "String", "Double", "Double") -> w3
  for {
    w4 = each element of $"tag paths"
    w5 = each element of w3
    call "Open Tag.gvi"(path=w4, data type=w5, error in=w2, configuration=w1) -> (tag out=w7, error out=w8)
    append w7 to w6
    stop if w8
  }
  $tags <- w6
  $"error out" <- w8
