vi "Read Example Tags.gvi"   [LabVIEW NXG 2.0.0]
inputs:
  "error in": error
  "tags in": "Tag.gtype"[]
outputs:
  "error out": error
  "example.skyline-data-services.numeric_gauge-indicator": f64
  "example.skyline-data-services.string_indicator": string
  "example.skyline-data-services.int_indicator": bool
  "tags out": "Tag.gtype"[]
  "Skyline.Examples.Oven.Outside.Temp-tank-indicator": f64
  "Skyline.Examples.Oven.Inside.Temp-tank-indicator": f64
types:
  "DataType.gtype" = enum{"Double", "Integer", "String"}
  "Client Handle.gtype" = u32
  "Configuration.gtype" = cluster{"Server URL": string, "Session": "Client Handle.gtype"}
  "Tag.gtype" = cluster{"Path": string, "Datatype": "DataType.gtype", "Configuration": "Configuration.gtype"}
uses:
  NI::Skyline::TagHTTP::Read Tag (I32).gvi
  NI::Skyline::TagHTTP::Read Tag (DBL).gvi
  NI::Skyline::TagHTTP::Read Tag (String).gvi
  NI::Skyline::TagHTTP::Multi Read.gvi
diagram:
  case ($"error in") {
    frame Error, Default {
      w1 = default
      w2 = default
      w3 = default
      w4 = $"error in"
      w5 = $"tags in"
      w6 = default
      w7 = default
    }
    frame No Error {
      disable {
        frame Enabled {
          Array Index(array=$"tags in") -> (out0[_]=w8, out1[_]=w9, out2[_]=w10, out3[_]=w11, out4[_]=w12)
          call "Read Tag (I32).gvi"(tag in=w8, error in=$"error in") -> (value=w13, error out=w14)
          Is Not Equal To 0(x=w13) -> w1
          call "Read Tag (DBL).gvi"(tag in=w9, error in=$"error in") -> (value=w2, error out=w15)
          call "Read Tag (String).gvi"(tag in=w10, error in=$"error in") -> (value=w3, error out=w16)
          call "Read Tag (DBL).gvi"(tag in=w11, error in=$"error in") -> (value=w6, error out=w17)
          call "Read Tag (DBL).gvi"(tag in=w12, error in=$"error in") -> (value=w7, error out=w18)
          Merge Errors(w14, w15, w16, w17, w18) -> (error out=w4)
          w5 = $"tags in"
        }
        frame Disabled {
          call "Multi Read.gvi"(tags in=$"tags in", error in=$"error in") -> (tags out=w5, tag clusters=w19, error out=w20)
          Array Index(array=w19) -> (out0[_]=w21, out1[_]=w22, out2[_]=w23, out3[_]=w24, out4[_]=w25)
          Property Node(instance in=w21) -> ("Value"=w26)
          Scan From String(inputString=w26, errIn=w20, default=FALSE) -> (errOut=w27, out0=w1)
          Property Node(instance in=w22) -> ("Value"=w28)
          Scan From String(inputString=w28, errIn=w20) -> (errOut=w29, out0=w2)
          Property Node(instance in=w24) -> ("Value"=w30)
          Scan From String(inputString=w30, errIn=w20) -> (errOut=w31, out0=w6)
          Property Node(instance in=w25) -> ("Value"=w32)
          Scan From String(inputString=w32, errIn=w20) -> (errOut=w33, out0=w7)
          Merge Errors(w27, w29, w31, w33) -> (error out=w4)
          Property Node(instance in=w23) -> ("Value"=w3)
        }
      }
    }
  }
  $"tags out" <- w5
  $"example.skyline-data-services.int_indicator" <- w1
  $"error out" <- w4
  $"example.skyline-data-services.numeric_gauge-indicator" <- w2
  $"example.skyline-data-services.string_indicator" <- w3
  $"Skyline.Examples.Oven.Inside.Temp-tank-indicator" <- w6
  $"Skyline.Examples.Oven.Outside.Temp-tank-indicator" <- w7
