vi "Write Example Tags.gvi"   [LabVIEW NXG 2.0.0]
inputs:
  "example.skyline-data-services.int_control": bool
  "error in": error
  "tags in": "Tag.gtype"[]
  "example.skyline-data-services.numeric_slider-control": f64
  "example.skyline-data-services.string_control": string
  "Skyline.Examples.Oven.Outside.Temp-slider-control": f64
  "Skyline.Examples.Oven.Inside.Temp-slider-control": f64
outputs:
  "errror out": error
  "tags out": "Tag.gtype"[]
types:
  "DataType.gtype" = enum{"Double", "Integer", "String"}
  "Client Handle.gtype" = u32
  "Configuration.gtype" = cluster{"Server URL": string, "Session": "Client Handle.gtype"}
  "Tag.gtype" = cluster{"Path": string, "Datatype": "DataType.gtype", "Configuration": "Configuration.gtype"}
  "Tag Cluster Web.gtype" = cluster{"Path": string, "Data Type": "DataType.gtype", "Value": string, "Time Stamp": timestamp}
  "Tag Cluster HTTP.gtype" = cluster{"Configuration": "Configuration.gtype", "Tag Cluster": "Tag Cluster Web.gtype"}
uses:
  NI::Skyline::TagHTTP::Write Tag (I32).gvi
  NI::Skyline::TagHTTP::Write Tag (DBL).gvi
  NI::Skyline::TagHTTP::Write Tag (String).gvi
  NI::Skyline::TagHTTP::Multi Write.gvi
diagram:
  case ($"error in") {
    frame Error, Default {
      w1 = $"error in"
      w2 = $"tags in"
    }
    frame No Error {
      Boolean To Integer(Boolean=$"example.skyline-data-services.int_control") -> (0, 1=w3)
      disable {
        frame Enabled {
          Array Index(array=$"tags in") -> (out0[_]=w4, out1[_]=w5, out2[_]=w6, out3[_]=w7, out4[_]=w8)
          call "Write Tag (I32).gvi"(tag in=w4, value=w3, error in=$"error in") -> (error out=w9)
          call "Write Tag (DBL).gvi"(tag in=w5, value=$"example.skyline-data-services.numeric_slider-control", error in=$"error in") -> (error out=w10)
          call "Write Tag (DBL).gvi"(tag in=w7, value=$"Skyline.Examples.Oven.Inside.Temp-slider-control", error in=$"error in") -> (error out=w11)
          call "Write Tag (DBL).gvi"(tag in=w8, value=$"Skyline.Examples.Oven.Outside.Temp-slider-control", error in=$"error in") -> (error out=w12)
          call "Write Tag (String).gvi"(tag in=w6, value=$"example.skyline-data-services.string_control", error in=$"error in") -> (error out=w13)
          Merge Errors(w9, w10, w13, w11, w12) -> (error out=w1)
        }
        frame Disabled {
          Format Into String(errIn=$"error in", w3) -> (outString=w14, errOut=w15)
          Format Into String(errIn=w15, $"example.skyline-data-services.numeric_slider-control") -> (outString=w16, errOut=w17)
          Build Array(w14, w16, $"example.skyline-data-services.string_control") -> w18
          # Working around bug where multi write has an error in dependency.
          for {
            w19 = each element of $"tags in"
            w20 = each element of w18
            Property Node(instance in=w19) -> ("Configuration"=w22, "Path"=w23, "Datatype"=w24)
            Property Node(instance in="Tag Cluster HTTP.gtype" {all zero or empty}, "Configuration"=w22, "Tag Cluster:Path"=w23, "Tag Cluster:Data Type"=w24, "Tag Cluster:Value"=w20) -> (instance out=w25)
            append w25 to w21
          }
          call "Multi Write.gvi"(tag clusters=w21, error in=w17) -> (error out=w1)
        }
      }
      w2 = $"tags in"
    }
  }
  $"errror out" <- w1
  $"tags out" <- w2
